# Dynamo graph Home.dyn (Dynamo 3.0.3.7597)

# group: Column of Room
# Takes the column points and creates column, type and level can be edited.
family_types = FamilyTypes("Rectangular Column:18\" x 18\"")
code_block = CodeBlock { x = 0; y = 0; z = 0; }
byCoordinates = Point.ByCoordinates(x=code_block.x, y=code_block.y, z=code_block.z)
code_block_2 = CodeBlock { x = 0; y = 20; z = 0; }
byCoordinates_2 = Point.ByCoordinates(x=code_block_2.x, y=code_block_2.y, z=code_block_2.z)
code_block_3 = CodeBlock { x = 0; y = 40; z = 0; }
byCoordinates_3 = Point.ByCoordinates(x=code_block_3.x, y=code_block_3.y, z=code_block_3.z)
code_block_4 = CodeBlock { x = 0; y = 60; z = 0; }
byCoordinates_4 = Point.ByCoordinates(x=code_block_4.x, y=code_block_4.y, z=code_block_4.z)
code_block_5 = CodeBlock { x = 0; y = 70; z = 0; }
byCoordinates_5 = Point.ByCoordinates(x=code_block_5.x, y=code_block_5.y, z=code_block_5.z)
code_block_6 = CodeBlock { x = 30; y = 0; z = 0; }
byCoordinates_6 = Point.ByCoordinates(x=code_block_6.x, y=code_block_6.y, z=code_block_6.z)
code_block_7 = CodeBlock { x = 30; y = 20; z = 0; }
byCoordinates_7 = Point.ByCoordinates(x=code_block_7.x, y=code_block_7.y, z=code_block_7.z)
code_block_8 = CodeBlock { x = 30; y = 40; z = 0; }
byCoordinates_8 = Point.ByCoordinates(x=code_block_8.x, y=code_block_8.y, z=code_block_8.z)
code_block_9 = CodeBlock { x = 30; y = 60; z = 0; }
byCoordinates_9 = Point.ByCoordinates(x=code_block_9.x, y=code_block_9.y, z=code_block_9.z)
code_block_10 = CodeBlock { x = 30; y = 70; z = 0; }
byCoordinates_10 = Point.ByCoordinates(x=code_block_10.x, y=code_block_10.y, z=code_block_10.z)
list_create = List.Create(item0=byCoordinates, item1=byCoordinates_2, item2=byCoordinates_3, item3=byCoordinates_4, item4=byCoordinates_5, item5=byCoordinates_6, item6=byCoordinates_7, item7=byCoordinates_8, item8=byCoordinates_9, item9=byCoordinates_10)
levels = Levels("Level 1")
byPointAndLevel = FamilyInstance.ByPointAndLevel(familyType=family_types, point=list_create, level=levels)

# group: Creation of Walls
number_slider = DoubleSlider(0, range=0..100 step 0.1)
number_slider_2 = DoubleSlider(0, range=0..100 step 0.1)
byCoordinates_11 = Point.ByCoordinates(x=number_slider, y=number_slider_2)
number_slider_3 = DoubleSlider(0, range=0..100 step 0.1)
number_slider_4 = DoubleSlider(70, range=-90..100 step 0.1)
byCoordinates_12 = Point.ByCoordinates(x=number_slider_3, y=number_slider_4)
byStartPointEndPoint = Line.ByStartPointEndPoint(startPoint=byCoordinates_11, endPoint=byCoordinates_12)
number_slider_5 = DoubleSlider(30, range=0..100 step 0.1)
number_slider_6 = DoubleSlider(70, range=-90..100 step 0.1)
byCoordinates_13 = Point.ByCoordinates(x=number_slider_5, y=number_slider_6)
number_slider_7 = DoubleSlider(30, range=0..100 step 0.1)
number_slider_8 = DoubleSlider(0, range=0..100 step 0.1)
byCoordinates_14 = Point.ByCoordinates(x=number_slider_7, y=number_slider_8)
byStartPointEndPoint_2 = Line.ByStartPointEndPoint(startPoint=byCoordinates_13, endPoint=byCoordinates_14)
number_slider_9 = DoubleSlider(30, range=0..100 step 0.1)
number_slider_10 = DoubleSlider(0, range=0..100 step 0.1)
byCoordinates_15 = Point.ByCoordinates(x=number_slider_9, y=number_slider_10)
number_slider_11 = DoubleSlider(0, range=0..100 step 0.1)
number_slider_12 = DoubleSlider(0, range=0..100 step 0.1)
byCoordinates_16 = Point.ByCoordinates(x=number_slider_11, y=number_slider_12)
byStartPointEndPoint_3 = Line.ByStartPointEndPoint(startPoint=byCoordinates_15, endPoint=byCoordinates_16)
number_slider_13 = DoubleSlider(0, range=0..100 step 0.1)
number_slider_14 = DoubleSlider(70, range=0..100 step 0.1)
byCoordinates_17 = Point.ByCoordinates(x=number_slider_13, y=number_slider_14)
number_slider_15 = DoubleSlider(30, range=0..100 step 0.1)
number_slider_16 = DoubleSlider(70, range=0..100 step 0.1)
byCoordinates_18 = Point.ByCoordinates(x=number_slider_15, y=number_slider_16)
byStartPointEndPoint_4 = Line.ByStartPointEndPoint(startPoint=byCoordinates_17, endPoint=byCoordinates_18)
number_slider_17 = DoubleSlider(10, range=0..100 step 0.1)
levels_2 = Levels("Level 1")
wall_types = WallTypes("Generic - 12\" Masonry")
byCurveAndHeight = Wall.ByCurveAndHeight(curve=byStartPointEndPoint_4, height=number_slider_17, level=levels_2, wallType=wall_types)
number_slider_18 = DoubleSlider(10, range=0..100 step 0.1)
levels_3 = Levels("Level 1")
wall_types_2 = WallTypes("Generic - 12\" Masonry")
byCurveAndHeight_2 = Wall.ByCurveAndHeight(curve=byStartPointEndPoint, height=number_slider_18, level=levels_3, wallType=wall_types_2)
number_slider_19 = DoubleSlider(10, range=0..100 step 0.1)
levels_4 = Levels("Level 1")
wall_types_3 = WallTypes("Generic - 12\" Masonry")
byCurveAndHeight_3 = Wall.ByCurveAndHeight(curve=byStartPointEndPoint_2, height=number_slider_19, level=levels_4, wallType=wall_types_3)
number_slider_20 = DoubleSlider(10, range=0..100 step 0.1)
levels_5 = Levels("Level 1")
wall_types_4 = WallTypes("Generic - 12\" Masonry")
byCurveAndHeight_4 = Wall.ByCurveAndHeight(curve=byStartPointEndPoint_3, height=number_slider_20, level=levels_5, wallType=wall_types_4)

# group: Creation of Floor
list_create_2 = List.Create(item0=byStartPointEndPoint, item1=byStartPointEndPoint_2, item2=byStartPointEndPoint_3, item3=byStartPointEndPoint_4)
byJoinedCurves = PolyCurve.ByJoinedCurves(curves=list_create_2)
ceiling_types = CeilingTypes("2' x 4' ACT System")
levels_6 = Levels("Level 1")
byOutlineTypeAndLevel = Ceiling.ByOutlineTypeAndLevel(outline=byJoinedCurves, ceilingType=ceiling_types, level=levels_6)

# group: Adjusting Height of Ceilings and Floor
number = DoubleInput(372609)
element_by_id = ElementById(Id=number)
string = StringInput("Base Offset From Level")
number_2 = DoubleInput(0)
setParameterByName = Element.SetParameterByName(element=element_by_id, parameterName=string, value=number_2)
number_3 = DoubleInput(373345)
element_by_id_2 = ElementById(Id=number_3)
string_2 = StringInput("Height Offset From Level")
number_4 = DoubleInput(1)
setParameterByName_2 = Element.SetParameterByName(element=element_by_id_2, parameterName=string_2, value=number_4)

# group: Creation of Top Ceiling
list_create_3 = List.Create(item0=byStartPointEndPoint, item1=byStartPointEndPoint_2, item2=byStartPointEndPoint_3, item3=byStartPointEndPoint_4)
byJoinedCurves_2 = PolyCurve.ByJoinedCurves(curves=list_create_3)
byJoinedCurves_3 = PolyCurve.ByJoinedCurves(curves=byJoinedCurves_2)
roof_types = RoofTypes("Generic - 12\"")
levels_7 = Levels("Level 2")
byOutlineTypeAndLevel_2 = Roof.ByOutlineTypeAndLevel(outline=byJoinedCurves_3, roofType=roof_types, level=levels_7)
watch = Watch(list_create_3)

# group: Creation of False Ceiling
list_create_4 = List.Create(item0=byStartPointEndPoint, item1=byStartPointEndPoint_2, item2=byStartPointEndPoint_3, item3=byStartPointEndPoint_4)
byJoinedCurves_4 = PolyCurve.ByJoinedCurves(curves=list_create_4)
floor_types = FloorTypes("LW Concrete on Metal Deck")
levels_8 = Levels("Level 1")
byOutlineTypeAndLevel_3 = Floor.ByOutlineTypeAndLevel(outline=byJoinedCurves_4, floorType=floor_types, level=levels_8)

# group: Creation of Windows
family_types_2 = FamilyTypes("Window-Casement-Double:41\" x 53\"")
number_5 = DoubleInput(372404)
element_by_id_3 = ElementById(Id=number_5)
code_block_11 = CodeBlock { x=10; y=0; z=0; }
byCoordinates_19 = Point.ByCoordinates(x=code_block_11.x, y=code_block_11.y, z=code_block_11.z)
list_create_5 = List.Create(item0=byCoordinates_19)
byHostAndPoint = FamilyInstance.ByHostAndPoint(familyType=family_types_2, host=element_by_id_3, point=list_create_5)

# group: Creations of Doors
family_types_3 = FamilyTypes("Single-Flush:36\" x 80\"")
number_6 = DoubleInput(372408)
element_by_id_4 = ElementById(Id=number_6)
code_block_12 = CodeBlock { x=10; y=10; z=0; }
byCoordinates_20 = Point.ByCoordinates(x=code_block_12.x, y=code_block_12.y, z=code_block_12.z)
list_create_6 = List.Create(item0=byCoordinates_20)
byHostAndPoint_2 = FamilyInstance.ByHostAndPoint(familyType=family_types_3, host=element_by_id_4, point=list_create_6)
